# Dynamo graph script1_hello_project.dyn (Dynamo 2.12.1.8246)
# packages: RengaDyn 1.0.5

# group: Получение группы свойств о Здании в свойствах проекта
application = DynRenga.DynDocument.Application.Application()
project = DynRenga.DynDocument.Project.Project.Project(renga_application=application)
IBuildingInfo = DynRenga.DynDocument.Project.Project.IBuildingInfo(project=project)
buildingInfo = DynRenga.DynDocument.Project.BuildingInfo.BuildingInfo(BuildingInfo_com=IBuildingInfo)

IProjectInfo = DynRenga.DynDocument.Project.Project.IProjectInfo(project=project)  # frozen
projectInfo = DynRenga.DynDocument.Project.ProjectInfo.ProjectInfo(ProjectInfo_com=IProjectInfo)
code = DynRenga.DynDocument.Project.ProjectInfo.Code(projectInfo=projectInfo)
name = DynRenga.DynDocument.Project.ProjectInfo.Name(projectInfo=projectInfo)
getProperties = DynRenga.DynDocument.Project.ProjectInfo.GetProperties(projectInfo=projectInfo)

# group: Получаем набор связанных свойств
getProperties_2 = DynRenga.DynDocument.Project.BuildingInfo.GetProperties(buildingInfo=buildingInfo)
propertyContainer = DynRenga.DynProperties.Properties.PropertyContainer.PropertyContainer(PropertyContainer_obj=getProperties_2)
getAllProperties = DynRenga.DynProperties.Properties.PropertyContainer.GetAllProperties(propertyContainer=propertyContainer)
property = DynRenga.DynProperties.Properties.Property.Property(Property_obj=getAllProperties)

name_2 = DynRenga.DynProperties.Properties.Property.Name(property=property)
name_3 = DynRenga.DynDocument.Project.BuildingInfo.Name(buildingInfo=buildingInfo)
getValue = DynRenga.DynProperties.Properties.Property.GetValue(property=property)
code_block = CodeBlock(a=getValue) { a[6]/1000.0; a[1]/1000.0; a[5]/1000.0; }
byCoordinates = Point.ByCoordinates(x=code_block.out0, y=code_block.out1, z=code_block.out2)
code_block_2 = CodeBlock { 5; }
byCenterPointRadius = Sphere.ByCenterPointRadius(centerPoint=byCoordinates, radius=code_block_2)
