# Dynamo graph script2_model_objects_selection.dyn (Dynamo 2.12.1.8246)
# packages: RengaDyn 1.0.5

application = DynRenga.DynDocument.Application.Application()
project = DynRenga.DynDocument.Project.Project.Project(renga_application=application)
model = DynRenga.DynDocument.Model.Model(project=project)

# group: Выбор всех
getModelObjects = DynRenga.DynObjects.Selection.GetModelObjects(renga_model=model)

# group: Выбор по уровню
getLevels = DynRenga.DynDocument.Level.GetLevels(renga_model=model)
getObjectsByLevel = DynRenga.DynObjects.Selection.GetObjectsByLevel(renga_model=model, com_ILevel=getLevels)
flatten = List.Flatten(list=getObjectsByLevel)
modelObject = DynRenga.DynObjects.ModelObject.ModelObject(model_object_com=flatten)
name = DynRenga.DynObjects.ModelObject.Name(modelObject=modelObject)

# group: Выбор объектов по типу
objectTypes = DynRenga.DynObjects.General.ObjectTypes()
list_create = List.Create(item0=objectTypes.Column, item1=objectTypes.Beam)
getObjectsByType = DynRenga.DynObjects.Selection.GetObjectsByType(renga_model=model, object_type=list_create)
modelObject_2 = DynRenga.DynObjects.ModelObject.ModelObject(model_object_com=getObjectsByType)
name_2 = DynRenga.DynObjects.ModelObject.Name(modelObject=modelObject_2)

# group: Выбор по индентификатору объекта модели
dataExporter = DynRenga.DynDocument.DataExporter.DataExporter(renga_project=project)
getExportedObjects3D = DynRenga.DynDocument.DataExporter.GetExportedObjects3D(dataExporter=dataExporter)
exportedObject3D = DynRenga.DynObjects.ExportedObject3D.ExportedObject3D(ExportedObject3D_obj=getExportedObjects3D)
modelObjectId = DynRenga.DynObjects.ExportedObject3D.ModelObjectId(exportedObject3D=exportedObject3D)
getModelObjectById = DynRenga.DynObjects.Selection.GetModelObjectById(renga_model=model, model_object_id=modelObjectId)
modelObject_3 = DynRenga.DynObjects.ModelObject.ModelObject(model_object_com=getModelObjectById)
name_3 = DynRenga.DynObjects.ModelObject.Name(modelObject=modelObject_3)
