# Dynamo graph script3_model objects data.dyn (Dynamo 2.12.1.8246)
# packages: RengaDyn 1.0.5

application = DynRenga.DynDocument.Application.Application()
project = DynRenga.DynDocument.Project.Project.Project(renga_application=application)
model = DynRenga.DynDocument.Model.Model(project=project)

# group: Выбор по уровню
getLevels = DynRenga.DynDocument.Level.GetLevels(renga_model=model)
getObjectsByLevel = DynRenga.DynObjects.Selection.GetObjectsByLevel(renga_model=model, com_ILevel=getLevels)
flatten = List.Flatten(list=getObjectsByLevel)
modelObject = DynRenga.DynObjects.ModelObject.ModelObject(model_object_com=flatten)
name = DynRenga.DynObjects.ModelObject.Name(modelObject=modelObject)

objectType = DynRenga.DynObjects.ModelObject.ObjectType(modelObject=modelObject)
getObjectIdAsString = DynRenga.DynObjects.General.GetObjectIdAsString(obj_type_guid=objectType)
getObjectsData = DynRenga.DynObjects.ModelObject.GetObjectsData(modelObject=modelObject)

# group: Get properties
propertyContainer = DynRenga.DynProperties.Properties.PropertyContainer.PropertyContainer(PropertyContainer_obj=getObjectsData.Properties_IPropertyContainer)
getAllProperties = DynRenga.DynProperties.Properties.PropertyContainer.GetAllProperties(propertyContainer=propertyContainer)
property = DynRenga.DynProperties.Properties.Property.Property(Property_obj=getAllProperties)
getValue = DynRenga.DynProperties.Properties.Property.GetValue(property=property)
type = DynRenga.DynProperties.Properties.Property.Type(property=property)
name_2 = DynRenga.DynProperties.Properties.Property.Name(property=property)

# group: Get quantities
quantityContainer = DynRenga.DynProperties.Quantities.QuantityContainer.QuantityContainer(renga_QuantityContainer_obj=getObjectsData.Quantities_IQuantityContainer)
getQuantities = DynRenga.DynProperties.Quantities.QuantityContainer.GetQuantities(quantityContainer=quantityContainer)
quantity = DynRenga.DynProperties.Quantities.Quantity.Quantity(renga_Quantity_obj=getQuantities.Quantities_objects_Renga_IQuantity)
type_2 = DynRenga.DynProperties.Quantities.Quantity.Type(quantity=quantity)
getTypeAsString = DynRenga.DynProperties.Quantities.Quantity.GetTypeAsString(type=type_2)
getValue_2 = DynRenga.DynProperties.Quantities.Quantity.GetValue(quantity=quantity)
getQuantityNameByGuid = DynRenga.DynProperties.Quantities.QuantityContainer.GetQuantityNameByGuid(quantity_guid=getQuantities.Quantites_id)

# group: Get parameters
parameterContainer = DynRenga.DynProperties.Parameters.ParameterContainer.ParameterContainer(ParameterContainer_obj=getObjectsData.Parameters_IParameterContainer)
getParameters = DynRenga.DynProperties.Parameters.ParameterContainer.GetParameters(parameterContainer=parameterContainer)
parameter = DynRenga.DynProperties.Parameters.Parameter.Parameter(Parameter_obj_com=getParameters.Parameters_object)
getValue_3 = DynRenga.DynProperties.Parameters.Parameter.GetValue(parameter=parameter)
definition = DynRenga.DynProperties.Parameters.Parameter.Definition(parameter=parameter)
parameterDefinition = DynRenga.DynProperties.Parameters.ParameterDefinition.ParameterDefinition(ParameterDefinition_obj_com=definition)
name_3 = DynRenga.DynProperties.Parameters.ParameterDefinition.Name(parameterDefinition=parameterDefinition)
getParameterTypeAsString = DynRenga.DynProperties.Parameters.ParameterDefinition.GetParameterTypeAsString(parameterDefinition=parameterDefinition)
