# Dynamo graph script4_model object geometry.dyn (Dynamo 2.12.1.8246)

application = DynRenga.DynDocument.Application.Application()
project = DynRenga.DynDocument.Project.Project.Project(renga_application=application)
dataExporter = DynRenga.DynDocument.DataExporter.DataExporter(renga_project=project)

# group: Геометрия через стандартный экспортер
getExportedObjects3D = DynRenga.DynDocument.DataExporter.GetExportedObjects3D(dataExporter=dataExporter)  # frozen
exportedObject3D = DynRenga.DynObjects.ExportedObject3D.ExportedObject3D(ExportedObject3D_obj=getExportedObjects3D)
getDynamoGeometry = DynRenga.DynObjects.ExportedObject3D.GetDynamoGeometry(exportedObject3D=exportedObject3D)

# group: Геометрия через сетки и материалы
getIGridsWithMaterial = DynRenga.DynDocument.DataExporter.GetIGridsWithMaterial(dataExporter=dataExporter)  # frozen
gridWithMaterial = DynRenga.DynObjects.GridWithMaterial.GridWithMaterial(GridWithMaterial_obj=getIGridsWithMaterial)
IGrid = DynRenga.DynObjects.GridWithMaterial.IGrid(gridWithMaterial=gridWithMaterial)
grid = DynRenga.DynObjects.Geometry.Grid.Grid(grid_obj=IGrid)
getDynamoGeometry_2 = DynRenga.DynObjects.Geometry.Grid.GetDynamoGeometry(grid=grid)
IGridMaterial = DynRenga.DynObjects.GridWithMaterial.IGridMaterial(gridWithMaterial=gridWithMaterial)
gridMaterial = DynRenga.Other.Material.GridMaterial.GridMaterial(GridMaterial_obj=IGridMaterial)
color = DynRenga.Other.Material.GridMaterial.Color(gridMaterial=gridMaterial)
code_block = CodeBlock(a=color) { a[0]; }
getColorDataByRengaColor = DynRenga.Other.RengaSimpleInterfaces.GetColorDataByRengaColor(renga_color_obj=code_block)

modelObjectId = DynRenga.DynObjects.ExportedObject3D.ModelObjectId(exportedObject3D=getExportedObjects3D)
model = DynRenga.DynDocument.Model.Model(project=project)

# group: Работа с ObjectParams интерфйес
objectTypes = DynRenga.DynObjects.General.ObjectTypes()
getObjectsByType = DynRenga.DynObjects.Selection.GetObjectsByType(renga_model=model, object_type=objectTypes.Route)
modelObject = DynRenga.DynObjects.ModelObject.ModelObject(model_object_com=getObjectsByType)
name = DynRenga.DynObjects.ModelObject.Name(modelObject=modelObject)
routeParams = DynRenga.DynProperties.Parameters.ObjectsParam.RouteParams.RouteParams(ModelObject_Route=getObjectsByType)
getContour = DynRenga.DynProperties.Parameters.ObjectsParam.RouteParams.GetContour(routeParams=routeParams)
curve3D = DynRenga.DynGeometry.Curve3D.Curve3D(Curve3D_object=getContour)
code_block_2 = CodeBlock { 5; }
toDynamoPolyCurve = DynRenga.DynGeometry.Curve3D.ToDynamoPolyCurve(curve3D=curve3D, parts_in_meter=code_block_2)

# group: Получение геометрии электрических линий
getObjectsByType_2 = DynRenga.DynObjects.Selection.GetObjectsByType(renga_model=model, object_type=objectTypes.LineElectricalCircuit)
modelObject_2 = DynRenga.DynObjects.ModelObject.ModelObject(model_object_com=getObjectsByType_2)
id = DynRenga.DynObjects.ModelObject.Id(modelObject=modelObject_2)
exportedObject3D_2 = DynRenga.DynObjects.ExportedObject3D.ExportedObject3D(data_exporter=dataExporter, modelobject_id=id)
getDynamoGeometry_3 = DynRenga.DynObjects.ExportedObject3D.GetDynamoGeometry(exportedObject3D=exportedObject3D_2)
