# Dynamo graph script5_load osm.dyn (Dynamo 2.12.1.8246)

# group: Информация о здании
application = DynRenga.DynDocument.Application.Application()
project = DynRenga.DynDocument.Project.Project.Project(renga_application=application)
IBuildingInfo = DynRenga.DynDocument.Project.Project.IBuildingInfo(project=project)
buildingInfo = DynRenga.DynDocument.Project.BuildingInfo.BuildingInfo(BuildingInfo_com=IBuildingInfo)

# group: Получение набора свойств информации о здании
getProperties = DynRenga.DynDocument.Project.BuildingInfo.GetProperties(buildingInfo=buildingInfo)
propertyContainer = DynRenga.DynProperties.Properties.PropertyContainer.PropertyContainer(PropertyContainer_obj=getProperties)
getAllProperties = DynRenga.DynProperties.Properties.PropertyContainer.GetAllProperties(propertyContainer=propertyContainer)
property = DynRenga.DynProperties.Properties.Property.Property(Property_obj=getAllProperties)
name = DynRenga.DynProperties.Properties.Property.Name(property=property)
getValue = DynRenga.DynProperties.Properties.Property.GetValue(property=property)

directory_path = Directory("E:\Temp")
code_block = CodeBlock { "test_2"; true; }

# group: Создание базовой точки здания
code_block_2 = CodeBlock(a=getValue) { a[3]/1000.0; a[2]/1000.0; 0.0; a[5]*(-1); 200.0; }
byCoordinates = Point.ByCoordinates(x=code_block_2.out0, y=code_block_2.out1, z=code_block_2.out2)

projected_russian_crs_list = dyn_proj_library.ProjDB_resources.projected_russian_crs_list()
code_block_3 = CodeBlock(a=projected_russian_crs_list.EPSG_codes) { a[148]; 4326; }

# group: Получение ограничиваюших точек
byCenterPointRadius = Circle.ByCenterPointRadius(centerPoint=byCoordinates, radius=code_block_2.out4)
byGeometry = BoundingBox.ByGeometry(geom=byCenterPointRadius)
minPoint = BoundingBox.MinPoint(boundingBox=byGeometry)
maxPoint = BoundingBox.MaxPoint(boundingBox=byGeometry)

# group: Пересчет координат точек в WGS-84
list_create = List.Create(item0=minPoint, item1=maxPoint)
reproject_dynamo_point = dyn_proj_library.Reprojecting.Reproject_dynamo_point(cs_source_code=code_block_3.out0, cs_target_code=code_block_3.out1, source_point=list_create)
code_block_4 = CodeBlock(a=reproject_dynamo_point) { a[0]; a[1]; }
Y = Point.Y(point=code_block_4.out0)
X = Point.X(point=code_block_4.out0)
Y_2 = Point.Y(point=code_block_4.out1)
X_2 = Point.X(point=code_block_4.out1)

# group: Получение данных из OSM
OSM_data = osm2dyn.OSM_data.OSM_data(min_longitude=Y, min_latitude=X, max_longitude=Y_2, max_latitude=X_2)
OSM_polygons = osm2dyn.OSM_data.OSM_polygons(oSM_data=OSM_data)
getGeometry = osm2dyn.OSM_object.GetGeometry(oSM_object=OSM_polygons)
getAttributes = osm2dyn.OSM_object.GetAttributes(oSM_object=OSM_polygons)

# group: Пересчет точек в систему координат модели ренга
code_block_5 = CodeBlock { 1.0; }
reproject_point_as_double_array = dyn_proj_library.Reprojecting.Reproject_point_as_double_array(cs_source_code=code_block_3.out1, cs_target_code=code_block_3.out0, source_point=getGeometry)
reprojecting = dyn_proj_library.Reprojecting.Reprojecting(dx=code_block_2.out0, dy=code_block_2.out1, dz=code_block_2.out2, angle_value=code_block_2.out3, scale=code_block_5, source_point=reproject_point_as_double_array)
dynamoPoint = dyn_proj_library.Reprojecting.DynamoPoint(reprojecting=reprojecting)

# group: Генерация Солидов для зданий
byPoints = Polygon.ByPoints(points=dynamoPoint)
code_block_6 = CodeBlock { 3.0; }
python_script = Python(IN[0]=byPoints, IN[1]=getAttributes, IN[2]=code_block_6)  # IronPython2
# ---------- python_script.python (22 lines) ----------
#input_data
polygons = IN[0]
attributes = IN[1]
storey_height = float(IN[2])

import clr
clr.AddReference('ProtoGeometry')
from Autodesk.DesignScript.Geometry import Curve, Line, Point, Polygon

counter_1 = 0
osm_buildins = list()
osm_natural = list()
for one_dict in attributes:
	#check, is that plg is building
	plg_needing = polygons[counter_1]
	plg_center = plg_needing.Center()
	if one_dict.get("building") != None:
		level_value_temp = one_dict.get("levels",storey_height)
		level_value = float(level_value_temp)*3.0
		osm_buildins.append(Curve.SweepAsSolid(plg_needing,Line.ByStartPointEndPoint(plg_center, Point.ByCoordinates(plg_center.X,plg_center.Y,plg_center.Z + level_value))))
	counter_1+=1
OUT = osm_buildins
# ----------------------------------------

ifc_document_specs = dyn2ifc.IfcFile.IfcDoc.ifc_document_specs()
ifc_units = dyn2ifc.IfcFile.IfcDoc.ifc_units()
initIfcDatabase = dyn2ifc.IfcFile.IfcDoc.InitIfcDatabase(ifc_type=ifc_document_specs.Ifc4Reference, units=ifc_units.Metre)
code_block_7 = CodeBlock(wait_data=python_script, ifc=initIfcDatabase) { wait_data; ifc; }
as_IfcShapeRepresentation = dyn2ifc.IfcGeometry.as_IfcShapeRepresentation.as_IfcShapeRepresentation(solid=code_block_7.wait_data)
get_IfcFaceBasedSurfaceModel = dyn2ifc.IfcGeometry.as_IfcShapeRepresentation.Get_IfcFaceBasedSurfaceModel(as_IfcShapeRepresentation=as_IfcShapeRepresentation)
code_block_8 = CodeBlock(a=initIfcDatabase) { "osm_data"; a; }
ifcGrouping = dyn2ifc.IfcGrouping.IfcGrouping(name=code_block_8.out0)
group = dyn2ifc.IfcGrouping.group(ifcGrouping=ifcGrouping)
to_IfcBuildingElementProxy = dyn2ifc.IfcObject.to_IfcBuildingElementProxy(ifcShapeRepresentation=get_IfcFaceBasedSurfaceModel, group=group)
code_block_9 = CodeBlock { "buiding"; null; }
code_block_10 = CodeBlock { "black"; [0.0,0.0,0.0]; }
ifcMaterialSet = dyn2ifc.IfcMaterialSet.IfcMaterialSet(color_data=code_block_10.out1, material_name=code_block_10.out0)
material = dyn2ifc.IfcMaterialSet.material(ifcMaterialSet=ifcMaterialSet)
ifcObject = dyn2ifc.IfcObject.IfcObject(ifc_element=to_IfcBuildingElementProxy, GlobalId=code_block_9.out0, name=code_block_9.out0, material=material, description=code_block_9.out0, properties=code_block_9.out1)
count = List.Count(list=ifcObject)
code_block_11 = CodeBlock(wait_objects=count, some_parameter=code_block_8.a) { wait_objects; some_parameter; }
saveIfc = dyn2ifc.IfcFile.IfcDoc.SaveIfc(directory_path=directory_path, file_name=code_block.out0, Overwrite=code_block.out1, aux_order=code_block_11.wait_objects)
